# Dynamo graph SetReviewedParameterForWalls.dyn "etReviewedParameterForWalls" (Dynamo 3.4.1.7055)
# packages: DynamoIronPython2.7 3.2.1

categories = Categories("OST_Walls")
all_elements_of_category = ElementsOfCategory(Category=categories)
python_script = Python(IN[0]=all_elements_of_category)  # IronPython2
# ---------- python_script.python (25 lines) ----------
import clr
clr.AddReference("RevitServices")
from RevitServices.Persistence import DocumentManager
from RevitServices.Transactions import TransactionManager

clr.AddReference("RevitAPI")
import Autodesk.Revit.DB as DB

# Get the current document
doc = DocumentManager.Instance.CurrentDBDocument

# Get the input walls and unwrap them
elements = UnwrapElement(IN[0])

# Begin transaction to modify the document
TransactionManager.Instance.EnsureInTransaction(doc)

for wall in elements:
    param = wall.LookupParameter("Reviewed")
    if param and not param.IsReadOnly:
        param.Set("Yes")

TransactionManager.Instance.TransactionTaskDone()

OUT = "Updated walls: {}".format(len(elements))
# ----------------------------------------
watch = Watch(python_script)
