# Dynamo graph Get_Wall_in_Excel.dyn "Script" (Dynamo 3.0.3.7597)

file_path = Filename("C:\Users\USER\OneDrive\Documents\Mine\Learning\Revit API\Trial\walls")
string = StringInput("Walls")
number = DoubleInput(0)
python_script = Python()  # CPython3; unwired: IN[0]
# ---------- python_script.python (26 lines) ----------
import clr
clr.AddReference('RevitServices')
from RevitServices.Persistence import DocumentManager

clr.AddReference('RevitAPI')
from Autodesk.Revit.DB import FilteredElementCollector, BuiltInCategory

# Access current document
doc = DocumentManager.Instance.CurrentDBDocument

# Collect all elements of a specific category (e.g., Walls)
elements = FilteredElementCollector(doc) \
    .OfCategory(BuiltInCategory.OST_Walls) \
    .WhereElementIsNotElementType() \
    .ToElements()

# Extract data: Id, Name, Category Name
element_data = []
for e in elements:
    try:
        data = [e.Id.IntegerValue, e.Name, e.Category.Name]
        element_data.append(data)
    except:
        element_data.append(["N/A", "N/A", "N/A"])

OUT = element_data
# ----------------------------------------
watch = Watch(python_script)
transpose = List.Transpose(lists=watch)
exportToExcel = Data.ExportToExcel(filePath=file_path, sheetName=string, startRow=number, startColumn=number, data=transpose)
